# Grasshopper definition 20231125_RebarShape.gh (Grasshopper 1.0.7)
# plug-ins: Bifocals, ShapeDiverForGrasshopper

sddp = ShapeDiverDocumentPayload({AbsoluteTolerance=0, AngleTolerance=0, DistanceDisplayPrecision=0, GltfVersion="Gltf2", InputGroups="{}", OutputGroups="{}", RelativeTolerance=0, UnitSystem=0, VersionCreated="1.13.1.0", VersionSaved="1.13.1.0"})
gallery = ImageGallery(CycleDelay=30, Randomize=False, UseLocalImages=True, UseRemoteImages=True)
b = Slider(398, range=0..1000)
c = Slider(246, range=0..1000)
d = Slider(323, range=0..1000)
e = Slider(172, range=0..1000)
f = Slider(250, range=0..1000)
g = Slider(200, range=0..1000)
h = Slider(196, range=0..1000)
number_slider = Slider(0, range=0..100)
xy = XYPlane(Origin=Point(0, 0, 0))
python = GhPythonScript(
    name="rg13",
    p=xy,
    a=Slider(253, range=0..1000),
    b=b,
    c=c,
    d=d,
    e=e,
    f=f,
    g=g,
    h=h,
    x=number_slider,
    y=number_slider,
    j=number_slider)  # -> out, curve; inputs p: Plane
# ---------- python: Python ----------
from rebar.rebarShape  import RebarShapeCurve

curve = RebarShapeCurve(name, p, a,b,c,d,e,f,g,h,x,y,j).curve
# ---------- end python ----------

# ----
# Color Format
# Input
data = Data(1)
# Method
data_2 = Data(1)
# Output
data_3 = Data(1)
# Display
data_4 = Data(1)
# Unuse
data_5 = Data(1)

panel = Panel(python.curve)
preview = CustomPreview(Geometry=python.curve, Material=ColourSwatch(SwatchColor=RGB(250, 0, 0)))
