# Grasshopper definition 20231130_test_readcsv.gh (Grasshopper 1.0.7)
# plug-ins: Bifocals, Rhino.Inside for Autodesk Revit

# ---- group: main
path = FilePath("G:\Shared drives\Development\100_Projects\0011_SZ_RibarTools\08_InternalWorkFolder\Wall2\New folder\ProgramInput_D-wall_Mainbar.csv")

# ----
path_2 = FilePath("G:\Shared drives\Development\100_Projects\0011_SZ_RibarTools\08_InternalWorkFolder\Wall2\New folder\ProgramInput_D-wall_Starterbar.csv")

# ---- group: dist
path_3 = FilePath("G:\Shared drives\Development\100_Projects\0011_SZ_RibarTools\08_InternalWorkFolder\Wall2\New folder\ProgramInput_D-wall_Distbar.csv")

# ---- group: shearlink
shearlink = FilePath("G:\Shared drives\Development\100_Projects\0011_SZ_RibarTools\08_InternalWorkFolder\Wall2\New folder\ProgramInput_D-wall_Shearlinks.csv")

# ---- group: Stiffner
shearlink_2 = FilePath("G:\Shared drives\Development\100_Projects\0011_SZ_RibarTools\08_InternalWorkFolder\Wall2\New folder\ProgramInput_D-wall_Stiffener.csv")

# ----
gallery = ImageGallery(CycleDelay=30, Randomize=False, UseLocalImages=True, UseRemoteImages=True)
path_4 = FilePath("G:\Shared drives\Development\100_Projects\0011_SZ_RibarTools\08_InternalWorkFolder\Wall2\New folder\ProgramInput_D-wall_Mainbar.csv")
panel = Panel(path)

# ---- group: RebarToolkit Uninstaller
rtuninstall = RebarToolkitInstaller()  # -> out, message; inputs uninstall: Boolean
# ---------- rtuninstall: Python ----------
__author__ = "ykish"
__version__ = "2023.11.28"

ghenv.Component.Name = 'RebarToolkit Installer'
ghenv.Component.NickName = 'RTUninstall'

ghenv.Component.Category = 'RebarToolkit'

import clr
import os
import shutil
clr.AddReference("System")
from System import Array
import Rhino

def remove_directory(path):
    """ Remove a directory and all its contents """
    if os.path.exists(path):
        shutil.rmtree(path)
        message = "Removed directory: {}".format(path)
    else:
        message = "Directory not found: {}".format(path)
    return message

def remove_from_python_search_paths(path):
    """ Remove a path from Rhino's Python script search paths """
    current_paths = list(Rhino.Runtime.PythonScript.SearchPaths)
    if path in current_paths:
        current_paths.remove(path)
        Rhino.Runtime.PythonScript.SearchPaths = Array[str](current_paths)
        message = "Removed from Python search paths: {}".format(path)
    else:
        message = "Path not found in Python search paths: {}".format(path)
    return message


if _uninstall:
    message =[]
    print("start uninstall")
    save_dir = os.path.join(os.environ["LOCALAPPDATA"], "GEL", "RebarToolkit")
    message.append(remove_directory(save_dir))
    package_dir= os.path.join(save_dir,'my_package')
    message.append(remove_from_python_search_paths(package_dir))
# ---------- end rtuninstall ----------

# ----
graphical_element = GraphicalElement(<wall referenced from the Revit model>)
python = GhPythonScript(path=path_4)  # -> out, a
# ---------- python: Python ----------
__author__ = "ykish"
__version__ = "2023.11.28"
import os
import rhinoscriptsyntax as rs
import csv
from rebar.rebarShape import RebarShapeCurve
def dictionary_from_csv(csv_path):
    """Read a CSV file and return a list of dictionaries of its contents."""
    with open(csv_path, 'r') as csv_file:
        # csv.DictReaderを使用してCSVファイルを読み込む
        dict_list = [row for row in csv.DictReader(csv_file)]
    return dict_list

csv_path = os.path.abspath(_path)
print(csv_path)
dict_list = dictionary_from_csv(csv_path)
print(dict_list)

shapes = [item['shape'] for item in dict_list]
print(shapes)

params_template = {'a': None, 'b': None, 'c': None, 'd': None, 'e': None, 'f': None, 'g': None, 'h': None, 'x': None, 'y': None, 'j': None}

updated_params_list = []
for d in dict_list:
    updated_params = params_template.copy()
    for key in updated_params:
        if key in d:
            if d[key] =="":
                updated_params[key] = None
            else:
                updated_params[key] = d[key]
    updated_params_list.append(updated_params)
def update_params_from_dict_list(dict_list, params_template):

    updated_params_list = []
    for d in dict_list:
        updated_params = params_template.copy()
        for key in updated_params:
            if key in d:
                updated_params[key] = None if d[key] == "" else d[key]
        updated_params_list.append(updated_params)
    
    return updated_params_list
    
def create_rebarShapeParams_from_csv(csv_path):
    dict_list = dictionary_from_csv(csv_path)
    params_template = {'a': None, 'b': None, 'c': None, 'd': None, 'e': None, 'f': None, 'g': None, 'h': None, 'x': None, 'y': None, 'j': None}
    updated_params_list = update_params_from_dict_list(dict_list, params_template)
    return updated_params_list

def create_rebarShape_from_csv(csv_path):
    params_list = create_rebarShapeParams_from_csv(csv_path)
    print(params_list[0])
    dict_list = dictionary_from_csv(csv_path)
    name_list = [d['name'] for d in dict_list]
    rebarShape_list = []
    for dict, i in enumerate(dict_list):
        rgType = "rg01"
        rebarShape_list.append(RebarShapeCurve(rgType, plane=None,**params_list[i]))
    return rebarShape_list
    
    

create_rebarShape_from_csv(csv_path)
# ---------- end python ----------
python_2 = GhPythonScript(path=panel)  # -> out, dict
# ---------- python_2: Python ----------
__author__ = "ykish"
__version__ = "2023.11.28"


from utils.utils import dictionary_from_csv
dict = dictionary_from_csv(_path)
# ---------- end python_2 ----------
python_3 = GhPythonScript(dict=python_2.dict)  # -> out, curve
# ---------- python_3: Python ----------
__author__ = "ykish"
__version__ = "2023.11.28"


from rebar.rebar import create_rebarShape_rhinoCurve_from_dict
from rebar.data_processor import find_row_by_name
from rebar.rebarShape import RebarShapeCurve

def create_rebarShapePrarams_from_dict(dict):
    params_template = {'a': None, 'b': None, 'c': None, 'd': None, 'e': None, 'f': None, 'g': None, 'h': None, 'x': None, 'y': None, 'j': None}
    updated_params = params_template.copy()
    for key in updated_params:
        if key in dict:
            updated_params[key] = None if dict[key] == "" else float(dict[key])
    return updated_params
            
shapeName = _dict['shape']
shapeName = "00" if shapeName =='0' else _dict['shape']
data= find_row_by_name(shapeName)
print(data)
rgName = data[0]['RhinoBaseLineType']
params = create_rebarShapePrarams_from_dict(_dict)
curve = RebarShapeCurve(rgName,shapeName, _plane,**params).curve
print(params)
# ---------- end python_3 ----------
python_4 = GhPythonScript(dict=python_2.dict)  # -> out, curve
# ---------- python_4: Python ----------
__author__ = "ykish"
__version__ = "2023.11.28"


from rebar.rebar import create_rebarShape_rhinoCurve_from_dict

curve = create_rebarShape_rhinoCurve_from_dict(_dict,_plane).curve
# ---------- end python_4 ----------
python_5 = GhPythonScript(dict=python_2.dict)  # -> out, name, face, z, x_offset, y_offset
# ---------- python_5: Python ----------
__author__ = "ykish"
__version__ = "2023.11.28"


name = _dict['name']
face = _dict['face']
z = _dict['z']
x_offset = _dict['x_offset']
y_offset = _dict['y_offset']
# ---------- end python_5 ----------
python_6 = GhPythonScript(host=graphical_element, dict=python_2.dict)  # -> out, rebar
# ---------- python_6: Python ----------
__author__ = "ykish"
__version__ = "2023.11.28"
from Autodesk.Revit.DB import Transaction,IFailuresPreprocessor,FilteredElementCollector,BuiltInParameter
from Autodesk.Revit.DB.Structure import Rebar, RebarBarType, RebarShape, RebarHookType,RebarReinforcementData, RebarCoupler,RebarCouplerError,RebarHookOrientation
from rebar.rebar import create_rebarShape_rhinoCurve_from_dict,get_rebar_shape_by_name,get_hook_orientation_from_shapename,get_hook_type_from_shapename
from utils.rhinoinside_utils import convert_rhino_to_revit_geometry, get_active_doc, get_active_ui_doc, convert_rhino_to_revit_length, convert_revit_to_rhino_length


class MyPreProcessor(IFailuresPreprocessor):
    def PreprocessFailures(self, failuresAccessor):
        transactionName = failuresAccessor.GetTransactionName()
        failMessages = failuresAccessor.GetFailureMessages()
        
        if failMessages.Count == 0:
            return FailureProcessingResult.Continue

        for currentMessage in failMessages:
            failID = currentMessage.GetFailureDefinitionId()
            if failID == BuiltInFailures.OverlapFailures.DuplicateRebar:
                failuresAccessor.DeleteWarning(currentMessage)
        
        return FailureProcessingResult.Continue
def get_rebar_type_by_diameter(rh_diameter):
    doc = get_active_doc()
    rebar_types = FilteredElementCollector(doc).OfClass(RebarBarType).ToElements()
    for rebar_type in rebar_types:
        print(rebar_type)
        print(rebar_type.BarModelDiameter)
        print(rebar_type.get_Parameter(BuiltInParameter.ALL_MODEL_TYPE_NAME).AsString())
        if rh_diameter in rebar_type.get_Parameter(BuiltInParameter.ALL_MODEL_TYPE_NAME).AsString():
            return rebar_type
    return None
    
def create_rebar_from_dict_CAS(dict,  plane, host):
    doc = get_active_doc()

    shape = create_rebarShape_rhinoCurve_from_dict(dict, plane)
    curves = shape.curve
    norm = shape.plane.Normal
    rv_norm = convert_rhino_to_revit_geometry(norm)
    rv_curves = [convert_rhino_to_revit_geometry(curve) for curve in curves]
    rv_shape = get_rebar_shape_by_name(shape.rv_name)
    rv_type = get_rebar_type_by_diameter(dict['diameter'])
    print( "--------------")
    print( dict['diameter'])
    print( "--------------")
    print(rv_type)
    rv_startHookOrientation = get_hook_orientation_from_shapename(shape.rv_name)[0]
    rv_endHookOrientation = get_hook_orientation_from_shapename(shape.rv_name)[1]
    rv_startHookType = get_hook_type_from_shapename(shape.rv_name)[0]
    rv_endHookType = get_hook_type_from_shapename(shape.rv_name)[1]
    rebar = Rebar.CreateFromCurvesAndShape(doc, rv_shape, rv_type, rv_startHookType, rv_endHookType, host, rv_norm, rv_curves, rv_startHookOrientation, rv_endHookOrientation)
    return rebar
    
doc = get_active_doc()

with Transaction(doc, 'create_bars') as t:
        t.Start()
        failureOptions = t.GetFailureHandlingOptions()
        handler = MyPreProcessor()
        t.SetFailureHandlingOptions(failureOptions)

        create_rebar_from_dict_CAS(_dict,_plane,_host)


        t.Commit()
# ---------- end python_6 ----------
python_7 = GhPythonScript()  # -> out, a
# ---------- python_7: Python ----------
__author__ = "ykish"
__version__ = "2023.11.30"

import clr
clr.AddReference('RhinoInside.Revit')
clr.AddReference('System.Core')
clr.AddReference('RevitAPI') 
clr.AddReference('RevitAPIUI')
import Autodesk.Revit.DB as DB
import RhinoInside.Revit.Convert.Geometry
clr.ImportExtensions(RhinoInside.Revit.Convert.Geometry)
# ---------- end python_7 ----------

# ----
# Color Format
# Input
data = Data(1)
# Method
data_2 = Data(1)
# Output
data_3 = Data(1)
# Display
data_4 = Data(1)
# Unuse
data_5 = Data(1)

crv = Curve(python_4.curve)
panel_2 = Panel(python_5.face)
bang = ExplodeTree(Data=crv)  # -> Branch0, Branch1, Branch2, Branch3, Branch4, Branch5, Branch6, Branch7
panel_3 = Panel(python_5.z)
panel_4 = Panel(python_2.dict)
crv_2 = Curve(bang.Branch7)
python_8 = GhPythonScript(dict=python_2.dict)  # -> out, name, face, z, x_offset, y_offset; same code as python_5
python_9 = GhPythonScript()  # -> out, a
# ---------- python_9: Python ----------
__author__ = "ykish"
__version__ = "2023.11.29"

import clr
clr.AddReference('RhinoInside.Revit')
clr.AddReference('System.Core')
clr.AddReference('RevitAPI') 
clr.AddReference('RevitAPIUI')
from RhinoInside.Revit import Revit, Convert
from Autodesk.Revit.DB import XYZ, Line as RevitLine, CurveArray, CurveArrArray,NurbSpline,BoundingBoxXYZ, Arc as RevitArc,Curve as RevitCurve,CurveLoop,CylindricalHelix, Ellipse as RevitEllipse,HermiteSpline 
from Rhino.Geometry import Arc, Circle,Point3d,Point3f, Vector3d,Vector3f,Line ,Polyline, PolyCurve, Curve, PolylineCurve, NurbsCurve,LineCurve,Ellipse,Arc,Circle,ArcCurve
# ---------- end python_9 ----------
