# Grasshopper definition installer_RebarRIRToolkit.gh (Grasshopper 1.0.7)
# plug-ins: Bifocals

gallery = ImageGallery(CycleDelay=30, Randomize=False, UseLocalImages=True, UseRemoteImages=True)

# ----
# Dowonload Python Code From Github
button = Button()
python = GhPythonScript(b=button)  # -> out, a
# ---------- python: Python ----------
__author__ = "ykish"
__version__ = "2023.10.02"

import System
import urllib
import zipfile
import os

def download_github_repo_as_zip(repo_url):
    # GitHubのリポジトリURLからZIPファイルのURLを生成
    zip_url = repo_url.rstrip('/') + '/archive/refs/heads/main.zip'
    
    # ZIPファイルをダウンロード
    response = urllib.urlopen(zip_url)
    data = response.read()
    
    # 指定の場所にZIPファイルを保存 C:\Users\[ユーザー名]\AppData\Local\GEL\RebarTool
    appdata_local = System.Environment.GetFolderPath(System.Environment.SpecialFolder.LocalApplicationData)
    gel_rebartool_directory = os.path.join(appdata_local, 'GEL', 'RebarTool')
    if not os.path.exists(gel_rebartool_directory):
        os.makedirs(gel_rebartool_directory)
    filename = "repository.zip"
    save_path = os.path.join(gel_rebartool_directory, filename)
    with open(save_path, 'wb') as file:
        file.write(data)
    return save_path, gel_rebartool_directory;

def unzip_file(zip_filepath, dest_dir):
    """
    ZIPファイルを解凍する関数

    Parameters:
    - zip_filepath: 解凍するZIPファイルのパス
    - dest_dir: 解凍したファイルを保存するディレクトリのパス
    """
    with zipfile.ZipFile(zip_filepath, 'r') as zip_ref:
        zip_ref.extractall(dest_dir)

# 使用例
repo_url = "https://github.com/GEL-Dev/RebarToolRIR" # Python 2ではraw_inputを使用""
save_path,gel_rebartool_directory = download_github_repo_as_zip(repo_url)
unzip_file(save_path,gel_rebartool_directory )
# ---------- end python ----------

path = FilePath("C:\Users\ykish\Documents\GitHub\RebarRIRToolkit\my_package\")
b = Slider(6405, range=0..10000)

# ---- group: GhPython Script
rtinstall = RebarToolkitInstaller(new_path=path)  # -> out, message
# ---------- rtinstall: Python ----------
__author__ = "ykish"
__version__ = "2023.11.24"


ghenv.Component.Name = 'RebarToolkit Installer'
ghenv.Component.NickName = 'RTInstall'
ghenv.Component.Message = '0.0.1'
ghenv.Component.Category = 'RebarToolkit'
ghenv.Component.SubCategory = '1 :: Version'
ghenv.Component.AdditionalHelpFromDocStrings = '0'

import os
import io
import subprocess
import System.Net
import System.Windows.Forms
import zipfile
import shutil
from distutils import dir_util
import Rhino
from Rhino.RhinoApp import Version as RHINO_VERSION
from Grasshopper.Folders import UserObjectFolders, DefaultAssemblyFolder
from Grasshopper.Kernel import GH_RuntimeMessageLevel as Message
from System import Array


    
_install = True
if _install:
    new_path = _new_path
    if new_path:
        current_paths = list(Rhino.Runtime.PythonScript.SearchPaths)
        if new_path not in current_paths:
            current_paths.append(new_path)
            Rhino.Runtime.PythonScript.SearchPaths = Array[str](current_paths)
        print(Rhino.Runtime.PythonScript.SearchPaths)
# ---------- end rtinstall ----------

# ----
python_2 = GhPythonScript()  # -> out, a; unedited script template
python_3 = GhPythonScript(name="rg01", a=Slider(4341, range=0..10000), b=b)  # -> out, line; inputs plane: Plane
# ---------- python_3: Python ----------
"""Provides a scripting component.
    Inputs:
        a: length of line
        b: length of line
        plane: The base plane
    Output:
        line: The line"""

import Rhino.Geometry as rg
from rebar.rebarShape import RebarShapeCurve

rb = RebarShapeCurve(name,plane,a,b,c,d,e,f,g,h,x,y,j)
line = rb.curve
# ---------- end python_3 ----------
lbinstall = LBInstaller()  # -> Vviiiiiz; plug-in component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
crv = Curve(python_3.line)

# ----
# Color Format
# Input
data = Data(1)
# Method
data_2 = Data(1)
# Output
data_3 = Data(1)
# Display
data_4 = Data(1)
# Unuse
data_5 = Data(1)
