# Grasshopper definition test3.gh (Grasshopper 1.0.7)
# Copyright: GEL
# plug-ins: Bifocals, Python

gallery = ImageGallery(CycleDelay=30, Randomize=False, UseLocalImages=True, UseRemoteImages=True)
# Covert Revt Check
number_slider = Slider(300, range=0..1000)
inneroutercurves = InnerOuterCurves()  # -> A, B_2
list = ValueList({"00": 1, "Two": 2, "Three": 2² - 1, "Four": Sqrt(16)}, selected="00")
inneroutercurves_2 = InnerOuterCurves()  # -> A, B_2
path = FilePath("C:\Users\ykish\Documents\GitHub\RebarRIRToolkit\gh_scripts\gh_rhinoinside_utils_test.py")
getrebardata = GetRebarData()  # -> out, centerline, diameter, quantity, spacing, rebartype
selectrebarshape = SelectRebarShape()  # -> out, selectedRebarShape, style
# ---------- selectrebarshape: Python ----------
__author__ = "ykish"
__version__ = "2023.05.08"

import rhinoscriptsyntax as rs

import clr
clr.AddReference('System.Core')
clr.AddReference('RhinoInside.Revit')
clr.AddReference('RevitAPI') 
clr.AddReference('RevitAPIUI')
import math
import Rhino
import RhinoInside
import Grasshopper
import ghpythonlib.treehelpers as th
import Grasshopper.Kernel.Data.GH_Path as GH_Path
import Grasshopper.DataTree as DataTree
import scriptcontext
from RhinoInside.Revit import Revit, Convert
from Autodesk.Revit import DB
from Autodesk.Revit.DB.Structure import *
from System.Collections.Generic import List, IList
from System import Enum, Action

doc = Revit.ActiveDBDocument
if shape is not None:

    allRebarShape  = DB.FilteredElementCollector(doc).OfClass(DB.Structure.RebarShape).WhereElementIsElementType().ToElements()
    selectedRebarShape = [rebarShape for rebarShape in allRebarShape if rebarShape.get_Parameter(DB.BuiltInParameter.ALL_MODEL_TYPE_NAME).AsString() == shape]
    style = [rebarShape.get_Parameter(DB.BuiltInParameter.REBAR_SHAPE_HOOK_STYLE).AsValueString() for rebarShape in selectedRebarShape]
for res in allRebarShape:
    print res.Id
    print doc.GetElement(res.Id).get_Parameter(DB.BuiltInParameter.REBAR_SHAPE_HOOK_STYLE)
# ---------- end selectrebarshape ----------
collectrebarbbyshape = CollectRebarbByShape()  # -> out, markRebars, shapeRebars
# ---------- collectrebarbbyshape: Python ----------
__author__ = "ykish"
__version__ = "2023.05.08"

import rhinoscriptsyntax as rs

import clr
clr.AddReference('System.Core')
clr.AddReference('RhinoInside.Revit')
clr.AddReference('RevitAPI') 
clr.AddReference('RevitAPIUI')
import math
import Rhino
import RhinoInside
import Grasshopper
import ghpythonlib.treehelpers as th
import Grasshopper.Kernel.Data.GH_Path as GH_Path
import Grasshopper.DataTree as DataTree
import scriptcontext
from RhinoInside.Revit import Revit, Convert
from Autodesk.Revit import DB
from Autodesk.Revit.DB.Structure import *
from System.Collections.Generic import List, IList
from System import Enum, Action

doc = Revit.ActiveDBDocument
if host is not None:
    # Get all rebars in the host
    allRebars  = DB.FilteredElementCollector(doc).OfClass(DB.Structure.Rebar).ToElements()
    slabRebars = [rebar for rebar in allRebars if rebar.GetHostId() == host.Id]
    markRebars = [rebar for rebar in allRebars if rebar.get_Parameter(DB.BuiltInParameter.ALL_MODEL_MARK).AsString() == mark]
    shapeRebars = [rebar for rebar in allRebars if rebar.get_Parameter(DB.BuiltInParameter.REBAR_SHAPE).AsString() == mark]
# ---------- end collectrebarbbyshape ----------
mycomponent = Python(shapeName=list)
getrebarshapebyname = GetRebarShapeByName()  # -> out, rebarShape
# ---------- getrebarshapebyname: Python ----------
__author__ = "ykish"
__version__ = "2023.05.08"

import rhinoscriptsyntax as rs

import clr
clr.AddReference('System.Core')
clr.AddReference('RhinoInside.Revit')
clr.AddReference('RevitAPI') 
clr.AddReference('RevitAPIUI')
import math
import Rhino
import RhinoInside
import Grasshopper
import ghpythonlib.treehelpers as th
import Grasshopper.Kernel.Data.GH_Path as GH_Path
import Grasshopper.DataTree as DataTree
import scriptcontext
from RhinoInside.Revit import Revit, Convert
from Autodesk.Revit import DB
from Autodesk.Revit.DB.Structure import *
from System.Collections.Generic import List, IList
from System import Enum, Action

doc = Revit.ActiveDBDocument
if shape is not None:

    allRebarShape  = DB.FilteredElementCollector(doc).OfClass(DB.Structure.RebarShape).WhereElementIsElementType().ToElements()
    rebarShape = [rebarShape for rebarShape in allRebarShape if rebarShape.get_Parameter(DB.BuiltInParameter.ALL_MODEL_TYPE_NAME).AsString() == shape]
'''
for res in allRebarShape:
    print res.Id
    print doc.GetElement(res.Id).get_Parameter(DB.BuiltInParameter.ALL_MODEL_TYPE_NAME).AsString()
    
'''
# ---------- end getrebarshapebyname ----------
file = ReadFile(File=path, PerLineParse=False)
pt = ConstructPoint(XCoordinate=0, YCoordinate=number_slider, ZCoordinate=0)
pt_2 = ConstructPoint(XCoordinate=0, YCoordinate=Slider(116, range=0..1000), ZCoordinate=0)
pt_3 = ConstructPoint(XCoordinate=0, YCoordinate=0, ZCoordinate=0)
python = GhPythonScript()  # -> out, a
# ---------- python: Python ----------
from my_package.utils.revit_utils import get_active_doc

a = get_active_doc()
# ---------- end python ----------
ln = Line(StartPoint=pt_3, EndPoint=pt)
pline = PolyLine(Vertices=[pt_3, pt, pt_2], Closed=False)
cir = Circle(Plane=PlaneXY(0, 0, 0), Radius=1)
panel = Panel(python.a)
collectrebar = CollectRebar()  # -> out, markRebars
# ---------- collectrebar: Python ----------
__author__ = "ykish"
__version__ = "2023.05.08"

import rhinoscriptsyntax as rs

import clr
clr.AddReference('System.Core')
clr.AddReference('RhinoInside.Revit')
clr.AddReference('RevitAPI') 
clr.AddReference('RevitAPIUI')
import math
import Rhino
import RhinoInside
import Grasshopper
import ghpythonlib.treehelpers as th
import Grasshopper.Kernel.Data.GH_Path as GH_Path
import Grasshopper.DataTree as DataTree
import scriptcontext
from RhinoInside.Revit import Revit, Convert
from Autodesk.Revit import DB
from Autodesk.Revit.DB.Structure import *
from System.Collections.Generic import List, IList
from System import Enum, Action

doc = Revit.ActiveDBDocument
if host is not None:
    # Get all rebars in the host
    allRebars  = DB.FilteredElementCollector(doc).OfClass(DB.Structure.Rebar).ToElements()
    slabRebars = [rebar for rebar in allRebars if rebar.GetHostId() == host.Id]
    markRebars = [rebar for rebar in allRebars if rebar.get_Parameter(DB.BuiltInParameter.ALL_MODEL_MARK).AsString() == mark]
# ---------- end collectrebar ----------
create_bars = GhPythonScript()  # -> results; inputs host: list, bar_curves: list, local_vec: list, quantity: list, pitch: list, rebar_types: list, shape_types: list, comment: list, run: Boolean
# ---------- create_bars: Python ----------
import rhinoscriptsyntax as rs

import clr
clr.AddReference('System.Core')
clr.AddReference('RhinoInside.Revit')
clr.AddReference('RevitAPI') 
clr.AddReference('RevitAPIUI')
import math
import Rhino
import RhinoInside
import Grasshopper
import ghpythonlib.treehelpers as th
import Grasshopper.Kernel.Data.GH_Path as GH_Path
import Grasshopper.DataTree as DataTree
import scriptcontext
from RhinoInside.Revit import Revit, Convert
from Autodesk.Revit import DB
from System.Collections.Generic import List, IList
from System import Enum, Action

class MyPreProcessor(DB.IFailuresPreprocessor):
    def PreprocessFailures(self, failuresAccessor):
        transactionName = failuresAccessor.GetTransactionName()
        failMessages = failuresAccessor.GetFailureMessages()
        
        if failMessages.Count == 0:
            return FailureProcessingResult.Continue

        for currentMessage in failMessages:
            failID = currentMessage.GetFailureDefinitionId()
            if failID == BuiltInFailures.OverlapFailures.DuplicateRebar:
                failuresAccessor.DeleteWarning(currentMessage)

            #failuresAccessor.ResolveFailure(currentMessage)
            #failuresAccessor.DeleteAllWarnings()	
            
        
        return FailureProcessingResult.Continue;

if run:
    doc = Revit.ActiveDBDocument
    bar_style = DB.Structure.RebarStyle.Standard
    hook_type = None
    
    hook_orient = DB.Structure.RebarHookOrientation.Right
    rebar_typeslist = rebar_types
    shape_typeslist = shape_types
    bar_curvelist = bar_curves
    local_veclist = local_vec
    
    curves = []
    norms = []
    shapes = []
    types = []
    rebars = []
    counts = []

    
    for i, line in enumerate(bar_curvelist):
        r_curve = Convert.Geometry.GeometryEncoder.ToCurve(line)
        curves.append([r_curve])
        norm = Convert.Geometry.GeometryEncoder.ToXYZ(local_veclist[i])
        norms.append(norm)
        type = rebar_typeslist[i]
        types.append(type)
        shape = shape_typeslist[i]
        shapes.append(shape)
    
    with DB.Transaction(doc, 'create_bars') as t:
        t.Start()
        
        failureOptions = t.GetFailureHandlingOptions()
        handler = MyPreProcessor()
        #failureOptions.SetFailuresPreprocessor(handler)
        t.SetFailureHandlingOptions(failureOptions)
        #OR exemple with GetFailureDefinitionId()
        #failureOptions.SetFailuresPreprocessor(DuplicateMarkSwallower())
        
        #2020
        #utid = DB.DisplayUnitType.DUT_MILLIMETERS
        
        for i,curve in enumerate(curves):
            
            #rebar = DB.Structure.Rebar.CreateFromCurvesAndShape(doc, shapes[i], types[i], hook_types[i], hook_types[i], host[0], norms[i], curve , hook_orient, hook_orient)
            #rebar = DB.Structure.Rebar.CreateFromCurvesAndShape(doc, shapes[i], types[i], hook_types_start[i], hook_types_end[i], host[0], norms[i], curve , hook_orient, hook_orient)
            rebar = DB.Structure.Rebar.CreateFromCurvesAndShape(doc, shapes[i], types[i], hook_type, hook_type, host[0], norms[i], curve , hook_orient, hook_orient)

            paraIndex = DB.BuiltInParameter.REBAR_SHAPE;
            param_shape = rebar.get_Parameter(paraIndex)
            param_shape.Set(shapes[i].Id)
            if comment:
                paraIndex = DB.BuiltInParameter.ALL_MODEL_MARK;
                param_comment = rebar.get_Parameter(paraIndex)
                param_comment.Set(comment[i])
            #paraIndex = DB.BuiltInParameter.REBAR_ELEM_HOOK_END_TYPE;
            #param_end = rebar.get_Parameter(paraIndex)
            #param_end.Set(hook_types_end[i].Id)
            #print(param)
            if  quantity and quantity[i]>1:
                space_feet = Convert.Geometry.GeometryEncoder.ToInternalLength(pitch[i])
                accessor = rebar.GetShapeDrivenAccessor()
                accessor.SetLayoutAsNumberWithSpacing(quantity[i],space_feet,True,True,True)
            
        if rebar.IsValidObject  :
            rebars.append(rebar.Id)
            
            
        
        t.Commit()
    results = rebars
# ---------- end create_bars ----------
python_2 = GhPythonScript()  # -> out, a
# ---------- python_2: Python ----------
__author__ = "ykish"
__version__ = "2023.11.20"

import rhinoscriptsyntax as rs
from my_package.utils.revit_utils import get_active_doc

doc = get_active_doc()
# ---------- end python_2 ----------
python_3 = GhPythonScript(x=pt_3, y=ln, z=pline, u=cir)  # -> out, a; inputs x: Point3d, y: Line, z: Polyline
# ---------- python_3: Python ----------
# -*- coding: utf-8 -*-
import importlib
import my_package
reload(my_package)

from my_package.utils.rhinoinside_utils import get_active_doc, get_active_ui_doc, convert_rhino_to_revit_geometry

doc = get_active_doc()
uidoc = get_active_ui_doc()


a = convert_rhino_to_revit_geometry(z)
# ---------- end python_3 ----------

# ----
# Color Format
# Input
data = Data(1)
# Method
data_2 = Data(1)
# Output
data_3 = Data(1)
# Display
# RebarRIRToolkit
data_4 = Data(1)
# Unuse
data_5 = Data(1)

panel_2 = Panel(python_3.a)
# Please specify the directory containing the 'RebarRIRToolkit' folder
path_2 = FilePath("C:\Users\ykish\Documents\GitHub\RebarRIRToolkit\")
addpathtosys = GhPythonScript(folder_path=path_2, add_to_path=Toggle(True), delete_to_path=Toggle(False))  # -> out, message
# ---------- addpathtosys: Python ----------
"""Provides a scripting component.
    Inputs:
        folder_path: The directory path to add to sys.path.
        add_to_path: Boolean to control whether to add folder_path to sys.path.
    Output:
        message: A message about the action taken or not taken."""

import sys

if add_to_path:
    if folder_path not in sys.path:
        sys.path.append(folder_path)
        message = "Added '{}' to sys.path".format(folder_path)
        print sys.path
    else:
        message = "'{}' already in sys.path".format(folder_path)
else:
    message = "Add to path is False. No action taken."
    
if delete_to_path:
    if folder_path in sys.path:
        sys.path.remove(folder_path)
        print sys.path
# ---------- end addpathtosys ----------
panel_3 = Panel(path_2)
panel_4 = Panel(addpathtosys.message)

# ==== cluster GetRebarData: Extract RebarData from Rebar Elements
element = ClusterInput()
python = GhPythonScript(element=element)  # -> out, centerLine, diameter, quantity, spacing, rebartype
# ---------- python: Python ----------
__author__ = "ykish"
__version__ = "2023.05.08"

import rhinoscriptsyntax as rs

import clr
clr.AddReference('System.Core')
clr.AddReference('RhinoInside.Revit')
clr.AddReference('RevitAPI') 
clr.AddReference('RevitAPIUI')
import math
import Rhino
import RhinoInside
import Grasshopper
import ghpythonlib.treehelpers as th
import Grasshopper.Kernel.Data.GH_Path as GH_Path
import Grasshopper.DataTree as DataTree
import scriptcontext
from RhinoInside.Revit import Revit, Convert
from Autodesk.Revit import DB
from Autodesk.Revit.DB.Structure import *
from System.Collections.Generic import List, IList
from System import Enum, Action

doc = Revit.ActiveDBDocument

def getRebarDiameter(rebar):
	bartypeId = rebar.GetTypeId()
	type = doc.GetElement(bartypeId)
	diameter = type.BarModelDiameter
	diameter = Convert.Geometry.GeometryDecoder.ToModelLength(diameter)
	return diameter, type
	
def getCenterLineCurves(rebar):
    revit_Curves = element.GetCenterlineCurves(0,0,0,MultiplanarOption.IncludeAllMultiplanarCurves,0)
    curves = []
    for rc in revit_Curves:
        if rc.GetType() == DB.Line:
            c = Convert.Geometry.GeometryDecoder.ToCurve(rc)
            curves.append(c)
        if rc.GetType() == DB.Arc:
            c = Convert.Geometry.GeometryDecoder.ToCurve(rc)
            curves.append(c)
    return curves

def getSpacing(rebar):
    layoutRule = rebar.LayoutRule
    
    if layoutRule == DB.Structure.RebarLayoutRule.Single:
        return 0
    else:
        s = rebar.MaxSpacing
        if s is not None:
            return Convert.Geometry.GeometryDecoder.ToModelLength(s)
    
    
centerLine = getCenterLineCurves(element)
diameter = getRebarDiameter(element)[0]

quantity = element.NumberOfBarPositions 
spacing = getSpacing(element)
rebartype = getRebarDiameter(element)[1]
# ---------- end python ----------
out = ClusterOutput(python.out)
quantity = ClusterOutput(python.quantity)
centerline = ClusterOutput(python.centerLine)
spacing = ClusterOutput(python.spacing)
diameter = ClusterOutput(python.diameter)
rebartype = ClusterOutput(python.rebartype)

# ==== cluster InnerOuterCurves: split outter curves and inner curves
B = ClusterInput()
edges = BrepEdges(Brep=B)  # -> Naked, Interior, NonManifold
join = JoinCurves(Curves=edges.Naked, Preserve=False)
area = Area(Geometry=join)  # -> Area, Centroid
sort = SortList(Keys=area.Area, ValuesA=join)  # -> Keys, reverse(ValuesA)
split = SplitList(List=sort.ValuesA, Index="1")  # -> ListA, ListB
A = ClusterOutput(split.ListA)
B_2 = ClusterOutput(split.ListB)
